# Grasshopper definition exercise.ghx (Grasshopper 1.0.8)
# plug-ins: RhinoCodePluginGH

crv = Curve([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])
pt = Point([Point(13.67899684, 16.30545845, 0), Point(62.44386743, 24.65839764, 0), Point(36.89619376, 53.00117238, 0), Point(67.76854653, 85.00856382, 0), Point(85.31582448, 73.66668253, 0), Point(40.59509567, 84.80409221, 0)])
extrudingcontours = Python3Script(contours=crv)  # -> out, a; inputs contours: list of Curve
# ---------- extrudingcontours: Python ----------
from logic import extrude_contours


a = extrude_contours(contours)
# ---------- end extrudingcontours ----------
attractorbars = Python3Script(attractors=pt)  # -> out, a; inputs attractors: list of Point3d
# ---------- attractorbars: Python ----------
from logic import draw_bars_with_attractors


draw_bars_with_attractors(attractors)
# ---------- end attractorbars ----------
panel = Panel(extrudingcontours.out)
preview = CustomPreview(
    Geometry=extrudingcontours.a,
    Material={diffuse=RGB(143, 188, 143), emission=RGB(66, 48, 66), shine=0.5, specular=RGB(255, 255, 255), transparency=0})

# ---- group: Module Watcher
toggle = BooleanToggle(True)
button = Button()

# ----
modulereloader = Python3Script(watch=toggle, reload=button)  # -> out; inputs watch: Boolean, reload: Boolean
# ---------- modulereloader: Python ----------
import os
import sys
import Grasshopper as gh
import scriptcontext as sc


def recompute_doc(e):
    for obj in ghenv.Component.OnPingDocument().Objects:
        if not obj.InstanceGuid == ghenv.Component.InstanceGuid:
            obj.ExpireSolution(False)


# Import가 제대로 작동하도록 PATH를 업데이트한다.
root_dir = os.path.dirname(ghdoc.Path)
if root_dir not in sys.path:
    sys.path.append(root_dir)
    # 로직 모듈을 불러들여 놓는다.
    import logic
    remember_key = "recomputed"
    if remember_key not in sc.sticky:
        # 그래스호퍼 문서 전체의 Recompute를 수행한다.
        sc.sticky[remember_key] = True
        ghenv.Component.OnPingDocument().ScheduleSolution(
            100, 
            recompute_doc
        )


from develop import watch_modules, reload_modules


watch_modules(watch)
reload_modules(reload)
# ---------- end modulereloader ----------

# ---- group: Module Watcher (continued)
panel_2 = Panel(modulereloader)
