# Grasshopper definition runner.ghx (Grasshopper 1.0.8)
# plug-ins: RhinoCodePluginGH

examplecode = Python3Script()  # -> out, a
# ---------- examplecode: Python ----------
from logic import say_hi, draw_pentagon


say_hi("MIKE")
a = draw_pentagon()
# ---------- end examplecode ----------
panel = Panel(examplecode.out)
geo = Geometry(examplecode.a)

# ---- group: Module Watcher
toggle = BooleanToggle(True)
button = Button()

# ----
modulereloader = Python3Script(watch=toggle, reload=button)  # -> out; inputs watch: Boolean, reload: Boolean
# ---------- modulereloader: Python ----------
import os
import sys
import Grasshopper as gh
import scriptcontext as sc


def recompute_doc(e):
    for obj in ghenv.Component.OnPingDocument().Objects:
        if not obj.InstanceGuid == ghenv.Component.InstanceGuid:
            obj.ExpireSolution(False)


# Import가 제대로 작동하도록 PATH를 업데이트한다.
root_dir = os.path.dirname(ghdoc.Path)
if root_dir not in sys.path:
    sys.path.append(root_dir)
    # 로직 모듈을 불러들여 놓는다.
    import logic
    remember_key = "recomputed"
    if remember_key not in sc.sticky:
        # 그래스호퍼 문서 전체의 Recompute를 수행한다.
        sc.sticky[remember_key] = True
        ghenv.Component.OnPingDocument().ScheduleSolution(
            100, 
            recompute_doc
        )


from develop import watch_modules, reload_modules


watch_modules(watch)
reload_modules(reload)
# ---------- end modulereloader ----------

# ---- group: Module Watcher (continued)
panel_2 = Panel(modulereloader)
